# Grasshopper definition sample_Sttings_001.gh (Grasshopper 1.0.7)
# plug-ins: WSCSharpJazz, Bifocals

# ----
# A_HelloWorld
# LIST INPUTS AND OUTPUTS
# TREE INPUTS AND OUTPUTS
a_04_formatlistandoutput = A_04_FormatListAndOutput()  # -> out, formattedText; inputs areasAsNumbers: list of Double
# ---------- a_04_formatlistandoutput: C# ----------
    List<string> areasAsText = new List<string>();
    for(int i = 0; i < areasAsNumbers.Count; i++){
      areasAsText.Add(string.Format("area[{0}]: {1:0.00}m²", i, areasAsNumbers[i]) );
      // "{0}" is swapped with the first argument after text string -> i
      // "{1}" is swapped with the second argument after text string -> areasAsNumbers[i] (i-th element of areas list)
    }
    
    formattedText = areasAsText; //outputting whole list
# ---------- end a_04_formatlistandoutput ----------
a_03_cultureinfoformat = A_03_CultureInfoFormat()  # -> out, A; inputs x: Double, y: Double
# ---------- a_03_cultureinfoformat: C# ----------
    System.Globalization.CultureInfo uk = System.Globalization.CultureInfo.GetCultureInfo("en-GB");
    string formatted = string.Format(uk, "x: {0:P2}; y: {1:C2}", x, y);
    //P means percent and C means currency.
    // Following number stands for number of decimal places you want to show
    Print(formatted);
# ---------- end a_03_cultureinfoformat ----------
a_02_formatstring = A_02_FormatString()  # -> out, A; inputs x: Double, y: Double
# ---------- a_02_formatstring: C# ----------
    Print("x: {0}; y: {1:.00}", x, y);   //{1:.000} means that a number will be always displayed with 3 decimal places 
    //(could be {1:0.00} for two places aswell). Useful eg. for pretty area display.
# ---------- end a_02_formatstring ----------
# Wickerson Studios Jazz Plugin C# Scripting in Visual Studio for Grasshopper
# ITEM INPUTS AND OUTPUTS
a_01_helloworld = A_01_HelloWorld()  # -> out, A
# ---------- a_01_helloworld: C# ----------
    Print("Hello world!");
# ---------- end a_01_helloworld ----------

range = Range(Domain=Domain(0, 1), Steps=10)
number_slider = Slider(2.557831, range=0..10)
number_slider_2 = Slider(3.35, range=0..10)
jitter = Jitter(List=range, Jitter=1, Seed=2)  # -> Values, Indices

a_formatingstring = A_FormatingString(NoformatNum=number_slider, FormatNum2Decimals=number_slider)
a_cultureinfo = A_CultureInfo(Percentage=Slider(0.5, range=0..1), FEnglishPounds=Slider(14.88, range=0..100))
a_formatareasasnumbers = A_FormatAreasAsNumbers(Areas=jitter.Values)
helloworldcomponent = HelloWorldComponent(StringA="Michael ", StringB="Wickerson")

panel = Panel(a_formatingstring)
panel_2 = Panel(a_cultureinfo)
panel_3 = Panel(a_formatareasasnumbers)
panel_4 = Panel(helloworldcomponent)

# ----
# B_BasicTypes
b_05_othertypes = B_05_OtherTypes()  # -> out, A; inputs someColour: Color, globalUniqueIdentifier: Guid
# ---------- b_05_othertypes: C# ----------
    //Complex is a structure from Grasshopper.Kernel.Types namespace;
    //DateTime is a structure from System namespace
    //Color is a structure from System.Drawing namespace
    //Guid is a structure from System namespace

    //all of these types are structures, so they are value types

    Print("complexNum is real: {0}", complexNum.IsReal);
    Print(dateAndTime.DayOfWeek.ToString());
    Print("Colour R: {0}, G: {1}, B: {2}", someColour.R, someColour.G, someColour.B);
    Print("Identifier: {0}", globalUniqueIdentifier.ToString());
# ---------- end b_05_othertypes ----------
b_01_inputoutputdata = B_01_InputOutputData()  # -> out, A, B, C; inputs x: Int32, y: Double, z: Boolean
# ---------- b_01_inputoutputdata: C# ----------
    A = x;
    B = y;
    C = z;
# ---------- end b_01_inputoutputdata ----------
b_03_rangesofnumericdatatypes = B_03_RangesOfNumericDataTypes()  # -> out, A
# ---------- b_03_rangesofnumericdatatypes: C# ----------
    //integral signed types - positive and negative values
    sbyte mySignedByteMin = sbyte.MinValue;
    sbyte mySignedByteMax = sbyte.MaxValue;

    short myInt16Min = short.MinValue;
    short myInt16Max = short.MaxValue;

    int myInt32Min = int.MinValue;
    int myInt32Max = int.MaxValue;

    long myInt64Min = long.MinValue;
    long myInt64Max = long.MaxValue;

    //integral unsigned types - only positive values
    byte myByteMin = byte.MinValue;
    byte myByteMax = byte.MaxValue;

    ushort myUnsignedInt16Min = ushort.MinValue;
    ushort myUnsignedInt16Max = ushort.MaxValue;

    uint myUnsignedInt32Min = uint.MinValue;
    uint myUnsignedInt32Max = uint.MaxValue;

    ulong myUnsignedInt64Min = ulong.MinValue;
    ulong myUnsignedInt64Max = ulong.MaxValue;

    //real numbers - always signed
    float myFloatingPtNumMin = float.MinValue;
    float myFloatingPtNumMax = float.MaxValue;

    double myDoublePrecisionNumMin = double.MinValue;
    double myDoublePrecisionNumMax = double.MaxValue;

    decimal myDecimalMin = decimal.MinValue;
    decimal myDecimalMax = decimal.MaxValue;

    Print("sbyte min: {0}, max: {1}, memory size [bytes]: {2}", mySignedByteMin, mySignedByteMax, sizeof(sbyte));
    Print("short min: {0}, max: {1}, memory size [bytes]: {2}", myInt16Min, myInt16Max, sizeof(short));
    Print("int min: {0}, max: {1}, memory size [bytes]: {2}", myInt32Min, myInt32Max, sizeof(int));
    Print("long min: {0}, max: {1}, memory size [bytes]: {2}", myInt64Min, myInt64Max, sizeof(long));
    Print("byte min: {0}, max: {1}, memory size [bytes]: {2}", myByteMin, myByteMax, sizeof(byte));
    Print("ushort min: {0}, max: {1}, memory size [bytes]: {2}", myUnsignedInt16Min, myUnsignedInt16Max, sizeof(ushort));
    Print("uint min: {0}, max: {1}, memory size [bytes]: {2}", myUnsignedInt32Min, myUnsignedInt32Max, sizeof(uint));
    Print("ulong min: {0}, max: {1}, memory size [bytes]: {2}", myUnsignedInt64Min, myUnsignedInt64Max, sizeof(ulong));
    Print("float min: {0}, max: {1}, memory size [bytes]: {2}", myFloatingPtNumMin, myFloatingPtNumMax, sizeof(float));
    Print("double min: {0}, max: {1}, memory size [bytes]: {2}", myDoublePrecisionNumMin, myDoublePrecisionNumMax, sizeof(double));
    Print("decimal min: {0}, max: {1}, memory size [bytes]: {2}", myDecimalMin, myDecimalMax, sizeof(decimal));
# ---------- end b_03_rangesofnumericdatatypes ----------
b_04_stringscharacters = B_04_StringsCharacters()  # -> out, A
# ---------- b_04_stringscharacters: C# ----------
    char character = 'a';  //char stores a single Unicode character and occupies 2 bytes
    Print("character: " + character.ToString());

    char newLine = '\n';  //can store special characters too;

    //string represents an immutable sequence of Unicode characters (an array of chars)
    string someText1 = "Some text";
    string someText2 = @"Verbatim sign
      makes it possible
      to write multi-line text.";
    string someText3 = someText1 + newLine + someText2;

    Print(someText1);
    Print(someText2);
    Print(someText3);
# ---------- end b_04_stringscharacters ----------
b_01_basicdatatypes = B_01_BasicDataTypes()  # -> out, A
# ---------- b_01_basicdatatypes: C# ----------
    int myInt = 0;
    int i=0, j = 1, k = 2;
    int otherInt;             //declaration without initialization - reserving memory, creating a blueprint for data
    otherInt = -10;           //initialization

    double myDouble = 0;
    double a, b, c;
    a = 10.3;
    b = -124.4;
    c = Math.PI;

    bool condition = false;   //can only be true or false
    bool flag = true;


    Print("myInt: {0} \ni: {1}, j:{2}, k:{3}", myInt, i, j, k);  //special character '/n' means new line
    Print("otherInt: " + otherInt.ToString());
    Print("myDouble: " + myDouble.ToString());
    Print("a: {0}, b: {1}, c: {2}", a, b, c);
    //when you use formatted string, ToString() method is automatically called for every argument
    Print("condition: " + condition.ToString() + "\n" + "flag: " + flag.ToString()); // '/n' once again
# ---------- end b_01_basicdatatypes ----------
number_slider_3 = Slider(1, range=0..1)
number_slider_4 = Slider(1, range=0..1)
ranges_of_numerical_datatypes = RangesOfNumericalDataTypes()  # -> SbyteFormatted, ShortFormatted
basic_data_types = BasicDataTypes(
    Integer1=number_slider_4,
    Integer2=number_slider_4,
    Double1=number_slider_3,
    Double2=number_slider_3,
    Boolean=Toggle(False))  # -> FormatIntegerOut, FormatIntegerOut_2, FormatDoubleOut, FormatDoubleOut_2, FormatBooleanOut
panel_5 = Panel([ranges_of_numerical_datatypes.SbyteFormatted, ranges_of_numerical_datatypes.ShortFormatted])
input_output_data_items = InputOutputDataItems(InputA="hot", InputB=Slider(2, range=0..10), InputC=Toggle(False))  # -> OutputA, OutputB, OutputC
panel_6 = Panel([input_output_data_items.OutputA, input_output_data_items.OutputB, input_output_data_items.OutputC])
panel_7 = Panel([basic_data_types.FormatIntegerOut, basic_data_types.FormatIntegerOut_2, basic_data_types.FormatDoubleOut, basic_data_types.FormatDoubleOut_2, basic_data_types.FormatBooleanOut])

# ----
# C_Complex Types
c_01_point3dstructure = C_01_Point3DStructure()  # -> out, point; inputs x: Double, y: Double, z: Double
# ---------- c_01_point3dstructure: C# ----------
    Point3d firstPoint = new Point3d(x, y, z);
    Print("firstPoint X: {0}, Y: {1}, Z: {2}", firstPoint.X, firstPoint.Y, firstPoint.Z);

    point = firstPoint;
# ---------- end c_01_point3dstructure ----------
point3d_structure = Point3dStructure(X=Slider(2.99, range=0..10), Y=Slider(2.99, range=0..10), Z=Slider(2.99, range=0..10))
panel_8 = Panel(point3d_structure)

# ----
# D_Basic Operators
panel_9 = Panel("1")
d_03_doubleconversionmathround = D_03_DoubleconversionMathround()  # -> out, convertedIntegerNum, convertedFloatingPtNum; inputs intNum: Int32, floatingPtNum: Double
# ---------- d_03_doubleconversionmathround: C# ----------
    int myInt = 0;
    double myDouble = 0;

    //myInt = y;      // error: explicit conversion needed (to make sure you know, you would lose data)
    myInt = (int) floatingPtNum; // ok, explicit conversion means "I know I lose fraction values"
    myDouble = intNum;   // ok, implicit conversion allowed, because no information is lost

    //myInt = Math.Round(y); // error: Math.Round returns a floating point number, so you need an explicit conversion
    myInt = (int) Math.Round(floatingPtNum); // ok

    convertedIntegerNum = myInt;
    convertedFloatingPtNum = myDouble;
# ---------- end d_03_doubleconversionmathround ----------
d_03_integerdivision = D_03_IntegerDivision(integerNum2=panel_9)  # -> out, integerDivision; inputs integerNum1: Int32, integerNum2: Int32
# ---------- d_03_integerdivision: C# ----------
    integerDivision =  integerNum1 / integerNum2;
    //fraction numbers will be lost
# ---------- end d_03_integerdivision ----------
d_05_integermodulodivision = D_05_IntegerModuloDivision(num2=panel_9)  # -> out, integerDivision, remainder; inputs num1: Double, num2: Double
# ---------- d_05_integermodulodivision: C# ----------
    integerDivision = (int) (num1 / num2);
    remainder = num1 % num2;
# ---------- end d_05_integermodulodivision ----------
d_01_basicoperators = D_01_BasicOperators(num2=panel_9)  # -> out, addition, difference, multiplication, division; inputs num1: Double, num2: Double
# ---------- d_01_basicoperators: C# ----------
    addition = num1 + num2;
    difference = num1 - num2;
    multiplication = num1 * num2;
    division = num1 / num2;
# ---------- end d_01_basicoperators ----------
d_07_incrementdecrement = D_07_IncrementDecrement()  # -> out, incrementedY, decrementedZ; inputs x: Double, y: Double, z: Double
# ---------- d_07_incrementdecrement: C# ----------
    Print("x += 3; \nx == {0}", x += 3);
    Print("x -= 6.4; \nx == {0}", x -= 6.4);
    Print("x *= 2; \nx == {0}", x *= 2);
    Print("x /= 3.5; \nx == {0}", x /= 3.5);


    y++;      //now y equals y+1
    incrementedY = y++; // incrementedY equals y before y++, but afterwards y equals y+2(in summary)
    decrementedZ = --z; // decrementedZ equals (z-1) and z equals (z-1) too.
    // if you put incrementation/ decrementation operator before a variable,
    // then it's computed before the statement. Otherwise it's computed afterwards
# ---------- end d_07_incrementdecrement ----------
d_09_toggleswitchab = D_09_ToggleSwitchAB()  # -> out, result; inputs toggle: Boolean
# ---------- d_09_toggleswitchab: C# ----------
    result = toggle ? valA : valB;
# ---------- end d_09_toggleswitchab ----------
d_06_equalityvsassignment = D_06_EqualityVSAssignment()  # -> out, equal; inputs x: Int32, y: Int32
# ---------- d_06_equalityvsassignment: C# ----------
    bool flag = false;

    flag = (x == y);  // == equality operator returns true or false, a boolean type
    //flag2 = (x = y);  // error! = is an assignment operator;

    equal = flag;
# ---------- end d_06_equalityvsassignment ----------
d_10_precedence = D_10_Precedence()  # -> out; inputs x: Double, y: Double, z: Double
# ---------- d_10_precedence: C# ----------
    Print("x + y / z = {0}", x + y / z);
    Print("(x + y) / z = {0}", (x + y) / z);
    Print("x + y / z++ = {0}", x + y / z++);
    Print("z after last operation = {0}", z);
    Print("z--... = {0}", --z);
    Print("(x + y) / ++z = {0}", x + y / ++z);
# ---------- end d_10_precedence ----------
d_02_naninfinity_infinity = D_02_NANInfinityInfinity()  # -> out, A
# ---------- d_02_naninfinity_infinity: C# ----------
    Print("double special values: \nNot a number: {0}\nPositiveInfinity: {1}\nNegativeInfinity: {2}", double.NaN, double.PositiveInfinity, double.NegativeInfinity);
# ---------- end d_02_naninfinity_infinity ----------
d_08_conditionaloperator = D_08_ConditionalOperator()  # -> out, notZero; inputs x: Int32
# ---------- d_08_conditionaloperator: C# ----------
    bool flag = false;
    flag = x != 0 ? true : false;
    
    //above instruction is equivalent to:
    // if(x!=0)
    //    flag = true;
    // else
    //    flag = false;
    
    // ...it is an elegant alternative
    
    notZero = flag;
# ---------- end d_08_conditionaloperator ----------
basic_operators = BasicOperators(Num1=Slider(2, range=0..10), Num2=Slider(0, range=0..10))  # -> Addition, Difference, Multiply, Division
panel_10 = Panel([basic_operators.Addition, basic_operators.Difference, basic_operators.Multiply, basic_operators.Division])
